# Grasshopper definition geom_lab.gh (Grasshopper 1.0.7)

# ---- group: Convex Hull Polygon
number_slider = Slider(9.022, range=0.25..20)
rectangle = Rectangle(Plane=PlaneXY(0, 0, 0), XSize=number_slider, YSize=number_slider, Radius=0)  # -> Rectangle, Length
pop2d = Populate2D(Region=rectangle.Rectangle, Count=Slider(3, range=3..20), Seed=Slider(181, range=0..300))
hull = ConvexHull(Points=pop2d, Plane=PlaneXY(0, 0, 0))  # -> Hull, HullZ, Indices

# ---- group: Locate, Rotate, R1 and R2 for Ellipse
number_slider_2 = Slider(0.4502, range=0..1)
number_slider_3 = Slider(0.3387, range=0..1)
crv_polygon = Curve(hull.Hull)
bbox = BoundingBox(Content=crv_polygon, Plane=PlaneXY(0, 0, 0))  # -> Box, Box_2
boxprop = BoxProperties(Box=bbox.Box)  # -> Center, Diagonal, Area, Volume, Degeneracy
pt = ConstructPoint(XCoordinate=number_slider_2, YCoordinate=number_slider_3, ZCoordinate=0)
vlen = VectorLength(Vector=boxprop.Diagonal)  # -> expr("x/2", Length)
srf = Surface(bbox.Box)
evalsrf = EvaluateSurface(Surface=reparameterize(srf), Point=pt)  # -> Point, Normal, UDirection, VDirection, Frame
number_slider_4 = Slider(103.485, range=0..180)
r1 = Slider(0.4844, range=0.1..1)
r2 = Slider(0.3882, range=0.1..1)
xy = XYPlane(Origin=evalsrf.Point)
prot = RotatePlane(Plane=xy, Angle=degrees(number_slider_4))
multiplication = Multiplication(A=r1, B=vlen)
multiplication_2 = Multiplication(A=r2, B=vlen)
ellipse = Ellipse(Plane=prot, Radius1=multiplication, Radius2=multiplication_2)  # -> Ellipse, Focus1, Focus2
crv = Curve(ellipse.Ellipse)

# ---- group: Condition C
disc = Discontinuity(Curve=crv_polygon, Level=1)  # -> Points, Parameters
incurve = PointInCurve(Point=disc.Points, Curve=ellipse.Ellipse)  # -> Relationship, Point
preview = CustomPreview(Geometry=disc.Points, Material=ColourSwatch(SwatchColor=RGB(255, 255, 255)))
bool = Boolean(incurve.Relationship)
ma = MassAddition(Input=bool)  # -> Result, PartialResults

# ----
galapagos = Galapagos(fitness=p_n_c_2, gene=[number_slider_2, number_slider_3, number_slider_4, r1, r2])

# ---- group: Condition A (Area)
area = Area(Geometry=ellipse.Ellipse)  # -> Area, Centroid
area_2 = Panel(area.Area)

# ---- group: Condition B
incurve_2 = PointInCurve(Point=evalsrf.Point, Curve=crv_polygon)  # -> Relationship, Point
equals = Equality(FirstNumber=incurve_2.Relationship, SecondNumber=2)  # -> Equality, Inequality
p_n_c = PickNChoose(Pattern=equals.Equality, Stream0="20", Stream1="0")

# ---- group: Condition D
ccx = CurveCurve(CurveA=ellipse.Ellipse, CurveB=crv_polygon)  # -> Points, ParamsA, ParamsB
lng = ListLength(List=ccx.Points)

# ----
addition = Addition(A=p_n_c, B=ma.Result, C=lng)
neg = Negative(Value=addition)
multiplication_3 = Multiplication(A=area.Area, B=neg)
bool_2 = Boolean(addition)
p_n_c_2 = PickNChoose(Pattern=bool_2, Stream0=area.Area, Stream1=multiplication_3)
